# Grasshopper definition CW4.0_WP1_WIP.gh (Grasshopper 1.0.7)
# plug-ins: Swiftlet, jSwan, LunchBox, 3D Graphic Statics V02, Pufferfish

# ----
# Use the one with port 5001 for testing
development_server_on_local_address = Panel("http://127.0.0.1:5001/residual_wood")

# ---- group: GET data from DB
# Get API request from Database
panel = Panel("https://wood-db.onrender.com/residual_wood")  # disabled
get = GETRequest(URL=panel)  # -> Status, Content, Response; disabled
dejson = DeserializeJson(JSON=get.Content, OutputsLocked=True)  # disabled
dejson_2 = DeserializeJson(JSON=dejson, OutputsLocked=True)  # -> Color, Density, Height, Id, Info, Length, Price, Requirements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; disabled

# ----
number_slider = Slider(4, range=0..10)
number_slider_2 = Slider(5, range=0..10)
number_slider_3 = Slider(4, range=0..10)
addition = Addition(A=number_slider_2, B=number_slider)
series = Series(Start=0, Step=1, Count=number_slider_2)
series_2 = Series(Start=number_slider_2, Step=1, Count=number_slider)
series_3 = Series(Start=addition, Step=1, Count=number_slider_3)

top_boundary = Brep(<brep referenced from the Rhino model>)
side_boundary = Brep(<brep referenced from the Rhino model>)
leg_boundary = Brep(<brep referenced from the Rhino model>)
length = Slider(380, range=0..1000)
width = Slider(70, range=0..100)
height = Slider(18, range=0..100)
int = Integer(number_slider_2)
int_2 = Integer(number_slider)
int_3 = Integer(number_slider_3)
rejsonkv = SerializeKeysAndValues(Key=["top", "side", "leg"], Value=[int, int_2, int_3])
debox = DeconstructBox(Box=top_boundary)  # -> Plane, X, Y, Z
int_4 = Integer(debox.X)
int_5 = Integer(debox.Y)
int_6 = Integer(debox.Z)
division = Division(A=int_5, B=number_slider_2)
dedomain = DeconstructDomain(Domain=debox.Y)  # -> Start, End
round = Round(Number=division)  # -> Nearest, Floor, Ceiling
addition_2 = Addition(A=dedomain.Start, B=division)
dims = Merge(Data1=int_4, Data2=round.Floor, Data3=int_6)
dom = ConstructDomain(DomainStart=dedomain.Start, DomainEnd=addition_2)
rejsonkv_2 = SerializeKeysAndValues(Key="dimensions", Value=dims)
series_4 = Series(Start=0, Step=division, Count=number_slider_2)
box = DomainBox(Base=debox.Plane, X=debox.X, Y=dom, Z=debox.Z)
Y = UnitY(Factor=series_4)
move = Move(Geometry=box, Motion=Y)  # -> Geometry, Transform

crossref = CrossReference(ListA=series, ListB="top", CrossMode=1)  # -> ListA, ListB
crossref_2 = CrossReference(ListA=series_2, ListB="side", CrossMode=1)  # -> ListA, ListB
crossref_3 = CrossReference(ListA=series_3, ListB="leg", CrossMode=1)  # -> ListA, ListB
development_server = Panel("http://127.0.0.1:5001/residual_wood/")
int_7 = Integer(Slider(10, range=0..10))
get_string = GetString(int_7, AtLeast=1, AtMost=1, TreeAccess=False)
concat = Concatenate(FragmentA="project_stool_", FragmentB=get_string)
panel_2 = Panel("http://localhost:5000/requirements/client")
panel_3 = Panel("application/json")
get_2 = GETRequest(URL=panel_2)  # -> Status, Content, Response
panel_4 = Panel(get_2.Content)

# ----
# Scenario 1 (PULL)
slider = Slider(150, range=1..1000)
python = GhPythonScript(x=slider)  # -> out, a; inputs x: Int32; disabled
# ---------- python: Python ----------
from datetime import datetime

a = []
for i in range(x):
    a.append(datetime.now().strftime("%Y-%m-%d %H:%M:%S"))
# ---------- end python ----------
cluster = Cluster(count=slider)  # -> genelist_a_2, genelist_b_2, genelist_c_2, C, genelist_g_2
number_slider_4 = Slider(6, range=0..10)  # disabled
srf = Surface(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)  # disabled
diagrid = DiagridStructure(Surface=srf, UDivisions=number_slider_4, VDivisions=number_slider_4, Type=True)  # -> StructureLines, StructureNodes; disabled
item = ListItem(List=dejson, Index=0, Wrap=True)  # -> Item1, Item; disabled
panel_5 = Panel(item.Item1)  # disabled
crv = Curve([<curve referenced from the Rhino model> x2])  # disabled

multiplication = Multiplication(A=cluster.genelist_a_2, B=cluster.genelist_b_2, C=cluster.genelist_c_2)  # disabled
division_2 = Division(A=multiplication, B=10000000)  # disabled
division_3 = Division(A=cluster.genelist_g_2, B=1000)  # disabled
division_4 = Division(A=division_3, B=division_2)  # disabled

# ---- group: POST data to DB
# Post API call  to Database
# DB Schema updated
entwine = Entwine(
    Branch00=cluster.genelist_a_2,
    Branch01=cluster.genelist_b_2,
    Branch02=cluster.genelist_c_2,
    Branch03=cluster.genelist_g_2,
    Branch04=division_4,
    Branch05=cluster.C,
    Branch06=python.a,
    FlattenInputs=True)  # -> simplify(Result); disabled
flip = FlipMatrix(Data=entwine)  # disabled
panel_6 = Panel("""id
length
width
height
weight
density
color
timestamp
info
requirements
reserved
reservation_name
reservation_time
source
price""")
rejsonkv_3 = SerializeKeysAndValues(Key=panel_6)  # -> flatten(JSON); disabled
panel_7 = Panel("https://wood-db.onrender.com/residual_wood")  # disabled
get_string_2 = GetString(rejsonkv_3, AtLeast=1, AtMost=2147483647, TreeAccess=False)  # disabled
ctb = CreateTextBody(
    Content=get_string_2,
    IsHtmlChecked=False,
    IsJavascriptChecked=False,
    IsJsonChecked=True,
    IsTextChecked=False,
    IsXmlChecked=False)  # disabled
post = POSTRequest(URL=panel_7, Body=ctb)  # -> Status, Content, Response; disabled

# ----
# Selection from Database based on Nearest Length
len = Length(Curve=crv)  # disabled
data = Data(len)  # disabled
sort = SortList(Keys=data, ValuesA=crv)  # -> Keys, ValuesA; disabled
python_2 = GhPythonScript(design_lengths=sort.Keys, database_lengths=dejson_2.Length)  # -> nearest_lengths; inputs design_lengths: list, database_lengths: list; disabled
# ---------- python_2: Python ----------
__author__ = "Javid Jooshesh, j.jooshesh@hva.nl"
__version__ = "v1"


def find_closest_members(array1, array2):
    closest_members = []
    for value in array1:
        nearest_value = min(array2, key=lambda x: abs(x - value))
        closest_members.append(nearest_value)
    return closest_members
    

nearest_lengths = find_closest_members(design_lengths, database_lengths)
# ---------- end python_2 ----------
keysearch = KeyValueSearch(Keys=dejson_2.Length, Values=dejson_2.Id, Search=python_2)  # disabled
index = ItemIndex(List=dejson_2.Id, Item=keysearch)  # disabled
item_2 = ListItem(List=dejson, Index=index, Wrap=True)  # disabled
dejson_3 = DeserializeJson(JSON=item_2, OutputsLocked=True)  # -> Color, Density, Height, Id, Info, Length, Price, Requirements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; disabled

# ----
# Wood from Database
number_slider_5 = Slider(242, range=0..1200)  # disabled
number_slider_6 = Slider(100, range=0..100)  # disabled
lng = ListLength(List=dejson_3.Id)  # disabled
pt = ConstructPoint(XCoordinate=0, YCoordinate=expr("x*2", number_slider_6), ZCoordinate=0)  # disabled
series_5 = Series(Start=0, Step=number_slider_5, Count=lng)  # disabled
Y_2 = UnitY(Factor=series_5)  # disabled
move_2 = Move(Geometry=pt, Motion=Y_2)  # -> Geometry, Transform; disabled
rectangle = Rectangle(Plane=move_2.Geometry, XSize=dejson_3.Length, YSize=dejson_3.Width, Radius=0)  # -> Rectangle, Length; disabled
boxrec = BoxRectangle(Rectangle=rectangle.Rectangle, Height=dejson_3.Height)  # disabled

length_tolerance = Slider(10, range=0..10)  # disabled
ratio = Slider(8.895, range=0..10)  # disabled
python_3 = GhPythonScript(
    wood_from_db=boxrec,
    design_boundary=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,
    heights=dejson_3.Height,
    line_segment=crv,
    tolerane=length_tolerance,
    ratio_tolerance=ratio)  # -> all_blocks, normal, linear_indecies, ratios, available_length; inputs wood_from_db: list, heights: list, line_segment: list; disabled
# ---------- python_3: Python ----------
"""__author__ = "Javid Jooshesh, j.jooshesh@hva.nl"
__version__ = "v1"
"""
import ghpythonlib.treehelpers as th
import rhinoscriptsyntax as rs
import Grasshopper.Kernel.Data as ghp
import Grasshopper.Kernel.Geometry.Plane as gh_plane


class Blocks:
    """_Class representing the wood plank geometries from the database_
    Attributes:
        source (DataTree[Breps]) : The list of box breps as a Grasshopper
            datatree
    Methods:
        explode_polysrf: ...
        explode_srf: ...
        get_block_length: ...
        get_block_width: ...
    """

    def __init__(self, source):
        """_Constructor of the class_
        Args:
            source (DataTree[objectid]) : The list of box breps
                as a Grasshopper datatree
        """

        self.source = source

    def __str__(self):
        return "A Class to Represent the Functions of " \
               "Form-Fitting for the Circular Wood Blocks from Scanned Database"

    def explode_polysrf(self):
        """Explode a brep object into the NURBS untrimmed surfaces"""
        p = []
        for i in range(len(self.source)):
            trimmed_srf = rs.ExplodePolysurfaces(self.source[i])
            blocks = []
            for srf in trimmed_srf:
                blocks.append(srf)
            p.append(blocks)
        data = th.list_to_tree(p, source=[0])
        return data

    def explode_srf(self):
        """Explode the surface into line segments"""
        p = []
        listed_tree = th.tree_to_list(self.explode_polysrf())
        curve = None
        for i in range(len(listed_tree)):
            curve_segments = []
            for j in range(len(listed_tree[i])):
                curve = rs.DuplicateEdgeCurves(listed_tree[i][j])
                curve_segments.append(curve)
            p.append(curve_segments)
        data = th.list_to_tree(p, source=[0])
        return data

    def get_block_length(self, position=2):
        """Return the length of the block as float. BigO(n^2)
            (not the most efficient way but it works for now)
        """
        list_of_lengths = []
        curves = th.tree_to_list(self.explode_srf())
        for i in range(len(curves)):
            blocks = []
            for j in range(len(curves[i])):
                lengths = []
                for k in range(len(curves[i][j])):
                    l = rs.CurveLength(curves[i][j][k])
                    lengths.append(l)
            blocks.append(sorted(lengths)[position])
            list_of_lengths.append(blocks)

        lengths_data_tree = th.list_to_tree(list_of_lengths, source=[0])
        return lengths_data_tree

    def get_block_width(self, position=1):
        """Return the width of the block as float"""
        widths = self.get_block_length(position=position)
        return widths
        
    def get_block_height(self, position=3):
        heights = self.get_block_length(position=position)
        return heights
    
    
class DesignModel:
    """_Class representing the design object and methods to fit the wood planks
    that are varaible in dimensions, within the boundary of the design_

    Attributes:
        design_region (DesignRegion) : The boundary of design
        blocks (Blocks) : The box breps representing the wood planks from the
            database
    Methods:
        orient: ...
        fit_blocks: ...
    """

    def __init__(self, design_region, blocks, heights, srf_index):
        """_Constructor method_"""

        self.region = DesignRegion(design_region, 0)
        self.srf_index = srf_index
        self.blocks = Blocks(blocks)
        self.blocks_length = self.blocks.get_block_length()
        self.blocks_width = self.blocks.get_block_width()
        self.blocks_height = heights
        self.index_list = []
        self.selection = []
        self.flatten_values()
    
    def flatten_values(self):
        """_Flatten the Length, Width and Height values_"""
        
        flatten_path_width = ghp.GH_Path(0)
        self.blocks_width.Flatten(flatten_path_width)
        flatten_path_length = ghp.GH_Path(0)
        self.blocks_length.Flatten(flatten_path_length)
        flatten_path_height = ghp.GH_Path(0)
        self.blocks_length.Flatten(flatten_path_height)


class DesignRegion:
    def __init__(self, brep, index):
        self.brep = brep
        self.index = index

    def explode(self):
        return rs.ExplodePolysurfaces(self.brep)

    def select_lowest_face(self):
        """Sort the faces of the Brep according to lowest `z` value of the
            centroids
        """
        exploded_surfaces = self.explode()
        z_coords = list()
        lowest_srf = None
        for i in range(len(exploded_surfaces)):
            centriod = rs.SurfaceAreaCentroid(exploded_surfaces[i])
            z_values = centriod[0][2]
            z_coords.append(z_values)
            if z_values == min(z_coords):
                lowest_srf = exploded_surfaces[i]
        return lowest_srf
    
    def select_custom_face(self, selected_index):
        exploded_surfaces = self.explode()
        for index, item in enumerate(exploded_surfaces):
            if index == selected_index:
                return item
    
    def find_edge(self, edge_index, surface_index):
        """Get the edge to populate blocks across within the design boundary"""
        selected_face = self.select_custom_face(surface_index)
        for index, item in enumerate(rs.DuplicateEdgeCurves(selected_face)):
            if index == edge_index:
                return item
                

class LinearElement:
    def __init__(self, line, blocks, used_blocks_index):
        self.blocks = Blocks(blocks)
        self.line = []
        for l in line:
            self.line.append(l)

        self.length = [rs.CurveLength(l) for l in self.line]
        self.start_point = [rs.CurvePoints(l)[0] for l in self.line]
        self.end_point = [rs.CurvePoints(l)[1] for l in self.line]
        self.normal_axis = []
        self.normal = []

        for i in range(len(self.start_point)):
            self.normal_axis.append(rs.VectorCreate(self.end_point[i], self.start_point[i]))
            self.normal.append(rs.PlaneFromNormal(self.start_point[i], self.normal_axis[i]))
        self.selection = []
        self.index_list = []
        self.used_index = used_blocks_index
        self.base = None
            
    def filter_used_blocks(self):
        unused_indexes = []
        for index in range(len(self.blocks.source)):
            if index in self.used_index:
                continue
            unused_indexes.append(index)
        return unused_indexes
    
    def pick_element(self, available_length, tolerane, r_tolerance):
        """_Select elements to build linear parts. Check the ratio
            of width and height as well_"""

        blocks_dict = {}    # blocks_dict = {lengths: blocks}
        lengths = th.tree_to_list(self.blocks.get_block_length())   # Python list
        
        filtered_blocks = self.filter_used_blocks()
        list_of_available_blocks = [self.blocks.source[i] for i in filtered_blocks]

        self.base = [rs.ExplodePolysurfaces(b)[1] for b in list_of_available_blocks]
        heights = [rs.SurfaceDomain(b, 1)[1] for b in self.base]
        widths = [rs.SurfaceDomain(b, 0)[1] for b in self.base]

        ratio = [widths[i] / heights[i] for i in range(len(heights))]

        for i in range(len(list_of_available_blocks)):
            if 0.5 < ratio[i] < r_tolerance:
                length = lengths[i][0]
                blocks_dict[length] = list_of_available_blocks[i]

        length_range = [range(int(l - (tolerane * 2)), int(l + (tolerane * 2))) for l in available_length]
        print(blocks_dict)
        block_list = []
        for i in range(len(length_range)):
            inner = []
            for key, value in blocks_dict.items():
                if int(key) in length_range[i]:
                    inner.append((value, key))
                    
                    self.selection.append(value)
                    del blocks_dict[key]
                    for index, item in enumerate(list_of_available_blocks):
                        if item == value:
                            self.index_list.append(index)
            block_list.append(inner)
#            print(inner)
        return th.list_to_tree(block_list[:], source=[0])


def main():
    global ratios
    global all_blocks
    global normal
    global linear_indecies
    global available_length
    
    test = DesignModel(design_boundary, wood_from_db, heights, 5)
    print(test)
    all_blocks = test.blocks.source
    packed_indecies = test.index_list
    packed_selection = test.selection

    normal = []
    li = []

    a = LinearElement(line_segment, wood_from_db, packed_indecies)
    available_length = []
        
    for i in line_segment:
        available_length.append(rs.CurveLength(i))

    ratios = a.pick_element(available_length, tolerane, ratio_tolerance)
    normal.append(a.normal)
    li.append(a.index_list)

    linear_indecies = th.list_to_tree(li, source=[0])
    linear_selection = a.selection
    normal = th.list_to_tree(normal, source=[0])


if __name__ == "__main__":
    main()
# ---------- end python_3 ----------

lng_2 = ListLength(List=crv)  # disabled
series_6 = Series(Start=0, Step=1, Count=lng_2)  # disabled
item_3 = ListItem(List=python_3.linear_indecies, Index=series_6, Wrap=True)  # disabled

# ---- group: GET data from DB
# Get the reserved data from the Residual Wood REST API
# 25 ms
development_server_on_local_address_2 = Panel("http://127.0.0.1:5000/residual_wood")
production_server_url = Panel("https://robotlab-residualwood.onrender.com/residual_wood")
get_request = Button()

# ----
dam = DataDam(DataA=production_server_url, DataC=get_request, BufferDelay=2500000, BufferMode=0)  # -> DataURL, DataC
get_3 = GETRequest(URL=dam.DataURL)  # -> Status, Content, Response
dejson_4 = DeserializeJson(JSON=get_3.Content, OutputsLocked=False)
number_slider_7 = Slider(3, range=0..10)
dejsonkv = DeserializeKeysAndValues(JSON=dejson_4)  # -> Key, Value
cull_i = CullIndex(List=dejsonkv.Value, Indices=number_slider_7, Wrap=True)
cull_i_2 = CullIndex(List=dejsonkv.Key, Indices=number_slider_7, Wrap=True)
rejsonkv_4 = SerializeKeysAndValues(Key=cull_i_2, Value=cull_i)  # -> flatten(JSON)
get_string_3 = GetString(rejsonkv_4, AtLeast=1, AtMost=1, TreeAccess=False)
ctb_2 = CreateTextBody(
    Content=get_string_3,
    IsHtmlChecked=False,
    IsJavascriptChecked=False,
    IsJsonChecked=True,
    IsTextChecked=False,
    IsXmlChecked=False)

# ---- group: Data to rollback changes
data_2 = Data(simplify(graft(ctb_2)))

# ----
# Scenario 2 (PUSH)
design_element_index = Slider(0, range=0..12)
milling_bit_radius = Slider(4, range=1..10)
brep = Brep([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])
bbox = BoundingBox(Content=brep, Plane=PlaneXY(0, 0, 0))  # -> Box, Box_2

# ---- group: Lenght of pieces
debrep = DeconstructBrep(Brep=bbox.Box)  # -> Faces, Edges, Vertices
len_2 = Length(Curve=debrep.Edges)
cset = CreateSet(List=len_2)  # -> Set, Map
sort_2 = SortList(Keys=cset.Set)  # -> Keys, ValuesA

# ---- group: GET data from DB (continued)
dam_2 = DataDam(
    DataA=design_element_index,
    DataB=development_server_on_local_address,
    DataC=get_request,
    BufferDelay=2500000,
    BufferMode=0)  # -> DataA, DataURL, DataC
get_4 = GETRequest(URL=dam_2.DataURL)  # -> Status, Content, Response
dejson_5 = DeserializeJson(JSON=get_4.Content, OutputsLocked=True)
dejson_6 = DeserializeJson(JSON=dejson_5, OutputsLocked=True)  # -> Color, Density, Height, Id, Info, Length, Price, Requirements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

# ---- group: Lengths
item_4 = ListItem(List=reverse(sort_2.Keys), Index=0, Wrap=True)  # -> flatten(Item)

# ---- group: Width
item_5 = ListItem(List=reverse(sort_2.Keys), Index=1, Wrap=True)  # -> flatten(Item)

# ---- group: Thickness
item_6 = ListItem(List=reverse(sort_2.Keys), Index=2, Wrap=True)  # -> flatten(Item)

# ---- group: Pre-selection from width / Width of Design element
item_7 = ListItem(List=item_5, Index=design_element_index, Wrap=True)

# ---- group: Visualizing design
addition_3 = Addition(A=design_element_index, B=1)
series_7 = Series(Start=0, Step=1, Count=addition_3)  # -> flatten(Series)
cull_i_3 = CullIndex(List=flatten(brep), Indices=series_7, Wrap=True)
preview = CustomPreview(Geometry=cull_i_3, Material=ColourSwatch(SwatchColor=RGBA(170, 0, 255, 90)))

# ---- group: Length of Design element
item_8 = ListItem(List=item_4, Index=design_element_index, Wrap=True)

# ---- group: Tree mask
concat_2 = Concatenate(FragmentA="{", FragmentB=design_element_index, FragmentC=";*}")

# ----
bbox_2 = BoundingBox(Content=brep, Plane=PlaneXY(0, 0, 0))  # -> Box, Box_2
item_9 = ListItem(List=bbox_2.Box, Index=series, Wrap=True)
item_10 = ListItem(List=bbox_2.Box, Index=series_2, Wrap=True)
item_11 = ListItem(List=bbox_2.Box, Index=series_3, Wrap=True)
entwine_2 = Entwine(Branch00=item_9, Branch01=series, Branch02=crossref.ListB, FlattenInputs=True)
entwine_3 = Entwine(Branch00=item_10, Branch01=series_2, Branch02=crossref_2.ListB, FlattenInputs=True)
entwine_4 = Entwine(Branch00=item_11, Branch01=series_3, Branch02=crossref_3.ListB, FlattenInputs=True)
merge = Merge(Data1=entwine_2, Data2=entwine_3, Data3=entwine_4)
branch = TreeBranch(Tree=merge, Path="{0;0}", MaintainPaths=True)
branch_2 = TreeBranch(Tree=merge, Path="{0;1}", MaintainPaths=True)
branch_3 = TreeBranch(Tree=merge, Path="{0;2}", MaintainPaths=True)

panel_8 = Panel("top")
panel_9 = Panel("side")
panel_10 = Panel("leg")
python_4 = GhPythonScript(key=panel_10, value=branch_3)  # -> out; inputs value: list
# ---------- python_4: Python ----------
__author__ = "jjooshe"
__version__ = "2023.06.07"

import rhinoscriptsyntax as rs
from ghpythonlib.treehelpers import list_to_tree 

output = []
for index, char in enumerate(value):
    if char == key:
        output.append(index)
        
out = list_to_tree(output)
# ---------- end python_4 ----------
python_5 = GhPythonScript(key="top", value=branch_3)  # -> out; inputs value: list; same code as python_4
python_6 = GhPythonScript(key="side", value=branch_3)  # -> out; inputs value: list; same code as python_4
item_12 = ListItem(List=branch, Index=python_5, Wrap=True)
item_13 = ListItem(List=branch, Index=python_6, Wrap=True)
item_14 = ListItem(List=branch, Index=python_4, Wrap=True)

int_8 = Integer(branch_2)
debrep_2 = DeconstructBrep(Brep=item_12)  # -> Faces, Edges, Vertices
debrep_3 = DeconstructBrep(Brep=item_13)  # -> Faces, Edges, Vertices
debrep_4 = DeconstructBrep(Brep=item_14)  # -> Faces, Edges, Vertices
len_3 = Length(Curve=debrep_2.Edges)
len_4 = Length(Curve=debrep_3.Edges)
len_5 = Length(Curve=debrep_4.Edges)
cset_2 = CreateSet(List=len_4)  # -> Set, Map
cset_3 = CreateSet(List=len_5)  # -> Set, Map
cset_4 = CreateSet(List=len_3)  # -> Set, Map
item_15 = ListItem(List=cset_2.Set, Index=0, Wrap=True)  # -> flatten(Item), flatten(Item1), flatten(Item2)
item_16 = ListItem(List=cset_3.Set, Index=0, Wrap=True)  # -> flatten(Item), flatten(Item1), flatten(Item2)
item_17 = ListItem(List=cset_4.Set, Index=0, Wrap=True)  # -> flatten(Item), flatten(Item1), flatten(Item2)
merge_2 = Merge(Data1=item_17.Item, Data2=item_17.Item1, Data3=item_17.Item2)
merge_3 = Merge(Data1=item_15.Item, Data2=item_15.Item1, Data3=item_15.Item2)
merge_4 = Merge(Data1=item_16.Item, Data2=item_16.Item1, Data3=item_16.Item2)
sort_3 = SortList(Keys=merge_2)  # -> reverse(Keys), ValuesA
lng_3 = ListLength(List=item_12)
sort_4 = SortList(Keys=merge_3)  # -> reverse(Keys), ValuesA
lng_4 = ListLength(List=item_13)
sort_5 = SortList(Keys=merge_4)  # -> reverse(Keys), ValuesA
lng_5 = ListLength(List=item_14)
partition = PartitionList(List=sort_5.Keys, Size=lng_5)  # -> simplify(Chunks)
partition_2 = PartitionList(List=sort_3.Keys, Size=lng_3)  # -> simplify(Chunks)
partition_3 = PartitionList(List=sort_4.Keys, Size=lng_4)  # -> simplify(Chunks)
bang = ExplodeTree(Data=partition)  # -> Branch0, Branch1, Branch2
bang_2 = ExplodeTree(Data=partition_2)  # -> Branch0, Branch1, Branch2
bang_3 = ExplodeTree(Data=partition_3)  # -> Branch0, Branch1, Branch2
lengths = Merge(Data1=bang_2.Branch0, Data2=bang_3.Branch0, Data3=bang.Branch0)
widths = Merge(Data1=bang_2.Branch1, Data2=bang_3.Branch1, Data3=bang.Branch1)
heights = Merge(Data1=bang_2.Branch2, Data2=bang_3.Branch2, Data3=bang.Branch2)
python_7 = GhPythonScript(x=lengths, y=widths, z=heights)  # -> out, a, b, c
# ---------- python_7: Python ----------
a = round(x, 2)
b = round(y, 2)
c = round(z, 2)
# ---------- end python_7 ----------
addition_4 = Addition(A=int_8, B=1)
rejson = SerializeJson(
    Part_index=addition_4,
    Length=python_7.a,
    Width=python_7.b,
    Height=python_7.c,
    Part=branch_3,
    Tag="chair",
    Project_id=concat,
    IncludeNullAndEmptyProperties=True)
lng_6 = ListLength(List=bbox_2.Box)
series_8 = Series(Start=0, Step=1, Count=lng_6)
item_18 = ListItem(List=rejson, Index=series_8, Wrap=True)
get_string_4 = GetString(item_18, AtLeast=1, AtMost=1, TreeAccess=False)
ctb_3 = CreateTextBody(
    Content=get_string_4,
    IsHtmlChecked=False,
    IsJavascriptChecked=False,
    IsJsonChecked=True,
    IsTextChecked=False,
    IsXmlChecked=False)
dam_3 = DataDam(DataA=ctb_3, BufferDelay=10000000, BufferMode=0)
post_2 = POSTRequest(URL=panel_2, Body=dam_3)  # -> Status, Content, Response
panel_11 = Panel(post_2.Content)

# ---- group: API call to remove the used wood based on ID
# DELETE from Database
panel_12 = Panel("https://wood-db.onrender.com/residual_wood")  # disabled
panel_13 = Panel("/")  # disabled

# ---- group: VISUAL
lng_7 = ListLength(List=dejson_6.Id)
rectangle_2 = Rectangle(Plane=PlaneXY(0, 0, 0), XSize=dejson_6.Length, YSize=dejson_6.Width, Radius=0)  # -> Rectangle, Length
series_9 = Series(Start=0, Step=Slider(171, range=0..200), Count=lng_7)
boxrec_2 = BoxRectangle(Rectangle=rectangle_2.Rectangle, Heights=dejson_6.Height)
Y_3 = UnitY(Factor=series_9)
move_3 = Move(Geometry=boxrec_2, Motion=Y_3)  # -> Geometry, Transform
preview_2 = CustomPreview(Geometry=move_3.Geometry, Material=dejson_6.Color)

# ---- group: Pre-selection from width
smaller = SmallerThan(FirstNumber=item_7, SecondNumber=dejson_6.Width)  # -> SmallerThan, OrEqualTo
cull = CullPattern(List=move_3.Geometry, CullPattern=smaller.OrEqualTo)
cull_2 = CullPattern(List=dejson_6.Id, CullPattern=smaller.OrEqualTo)

# ---- group: VISUAL (continued)
volume = Volume(Geometry=cull)  # -> Volume, Centroid
debrep_5 = DeconstructBrep(Brep=cull)  # -> Faces, Edges, Vertices
linedim = LineDimension(Line=debrep_5.Edges, Text="{0:0.00}", Size=Slider(10, range=0..10))
tag = TextTag(Location=volume.Centroid, Text=cull_2, Colour="#000000")

# ---- group: DB elements (geometries)
data_3 = Data(cull)

# ----
cull_3 = CullPattern(List=dejson_6.Length, CullPattern=smaller.OrEqualTo)
python_8 = GhPythonScript(design_elements=item_4, database_elements=cull_3, bit_diameter=milling_bit_radius)  # -> guide, simplify(index_list); inputs design_elements: list, database_elements: list
# ---------- python_8: Python ----------
"""__author__ = "Javid Jooshesh, j.jooshesh@hva.nl"
__version__ = "v1"
"""

import rhinoscriptsyntax as rs
import Grasshopper.DataTree as dt
import ghpythonlib.treehelpers as th

pairs = []

for i in range(len(database_elements)):
    for j in range(len(design_elements)):
        if database_elements[i] / (design_elements[j] + bit_diameter) >= 1:
            pairs.append(
                (i, j, float(
                    database_elements[i] / (design_elements[j] + bit_diameter)
                )
            )
        )
            
dic = {}

# Hashtable
for i in range(len(design_elements)):
    dic[i] = []
    
for i in range(len(pairs)):
    if pairs[i][1] in dic.keys():
        dic[pairs[i][1]].append(
            (pairs[i][0], pairs[i][2])
        ) if pairs[i][2] >= 1 else None

index_list = th.list_to_tree(
    [
        dic[i] for i in range(len(design_elements))
    ], source=[0]
)

msg = "Database Index: {0}, Design Element Index: {1}, Amounts per Element: {2}"
for i in range(len(pairs)):
    a = pairs[i][0]
    b = pairs[i][1]
    c = pairs[i][2]
    print(msg.format(a, b, c))
# ---------- end python_8 ----------
split = SplitTree(Data=python_8.index_list, Masks=flatten(concat_2))  # -> Positive, Negative
info = ListItem(List=split.Positive, Index=0, Wrap=True)  # -> Item, Item1
panel_14 = Panel(python_8.guide)
item_19 = ListItem(List=cull_3, Index=flatten(info.Item), Wrap=True)

# ---- group: Amounts per Elements
data_4 = Data(info.Item1)

# ----
item_20 = ListItem(List=brep, Index=design_element_index, Wrap=True)
item_21 = ListItem(List=data_3, Index=flatten(info.Item), Wrap=True)
item_22 = ListItem(List=bbox.Box, Index=design_element_index, Wrap=True)

toint = RoundToInteger(Number=data_4)  # -> NumClosest, NumUp, NumDn

# ---- group: Pairs (Design & DB elements)
entwine_5 = Entwine(Branch00=item_20, Branch01=item_21, FlattenInputs=True)

# ---- group: Database Index
data_5 = Data(info.Item)

# ----
int_9 = Integer(toint.NumDn)
panel_15 = Panel([data_5, int_9])
panel_16 = Panel(toint.NumDn)

organize_data = GhPythonScript(ape=flatten(int_9), db_index=flatten(info.Item), remained_lengths=item_19)  # -> organized_data; inputs ape: list, db_index: list, remained_lengths: list
# ---------- organize_data: Python ----------
__author__ = "Javid Jooshesh"
__version__ = "2022.11.04"

import rhinoscriptsyntax as rs
import ghpythonlib.treehelpers as th
 

def organize(param_1, param_2, param_3):
    """ Organize the given data as parameters. This function is used to
        organize the elements with the criteria of length and the factor of 
        APE (Amount Per Element). 
        
        param_1: A set from the list of APE as inputs
        param_2: List of indecies of usable elements from the database
        param_3: Remained length of the usable elements in the database at the
            index of `param_2`
        
        returns: Dictionary of the data organized in the following way:
                   {
                param_1: {
                    'index_list': [param_2],
                    'remained_lengths': [param_3]
                }
            }
    """
    hashtable = dict()
    FIRST_ARG = 0
    SECOND_ARG = 1
    data = zip(param_1, param_2, param_3)
            
    for i in range(len(param_1)):
        hashtable[param_1[i]] = {'index_list': [], 'remained_lengths': []}
                
    for i in range(len(data)):
        if data[i][FIRST_ARG] in hashtable.keys():
            hashtable[data[i][FIRST_ARG]]['index_list'].append(data[i][SECOND_ARG])
            hashtable[data[i][FIRST_ARG]]['remained_lengths'].append(param_3[i])
                    
    return hashtable
    

if __name__ == "__main__":
    organized_data = str(organize(ape, db_index, remained_lengths))
    print(organized_data)
# ---------- end organize_data ----------

# ----
# Take the index of elements in
# the database, and check per every
# design element indecies. Compare the
# length of each part, and evaluate how many parts are possible to get
# from each element in the database. (APE)
# 
# Create a Queue of elements to be used from the database.
# Once each element is dequeued from the task, the remaining length of the
# database element will be updated as it's original length will be deducted
# by the length of the design element which was cutout from it.
python_9 = GhPythonScript(
    des_index=design_element_index,
    lengths=item_8,
    db_index=flatten(info.Item),
    remained_lengths=item_19,
    ape=flatten(int_9),
    filtered_widths_indecies=cull_2)  # -> remaining_length, db_index_to_update; inputs des_index: list of Int32, lengths: list, db_index: list of Int32, remained_lengths: list, ape: list of Int32, filtered_widths_indecies: list
# ---------- python_9: Python ----------
"""
__Matching Algorithm__
__author__ = "Javid Jooshesh, j.jooshesh@hva.nl"
__version__ = "v1"
"""

        
class Node:
    def __init__(self, value):
        self.value = value
        self.next = None
        
        
class Queue:
    """_A class representing the Queue data structure based on the FIFO 
        (first in first out) principle_"""
            
    def __init__(self, value):
        """_Init method of the class_"""
                
        new_node = Node(value)
        self.first = new_node
        self.last = new_node
        self.length = 1
        
    def print_queue(self):
        """_A method to print the nodes of the queue_"""
                
        current = self.first
        while current:
            print(current.value)
            current = current.next
        
    def enqueue(self, value):
        """_Add a node to the queue_"""
                
        new_node = Node(value)
        if self.length == 0:
            self.first = new_node
            self.last = new_node
        else:
            self.last.next = new_node
            self.last = new_node
        self.length += 1
        
    def dequeue(self):
        """_Remove a node from the queue_"""
                
        if self.length == 0:
            return None
        current = self.first
        if self.length == 1:
            self.first = None
            self.last = None
        else:
            self.first = self.first.next
            current.next = None
        self.length -= 1
        return current
        

class PushDesignMethod:
    
    def __init__(self):
        self.ape = ape
        self.db_index = db_index
        self.remained_lengths = remained_lengths
        self.remainder = None
        self.lengths = lengths
        self.design_elements_index = None
        self.db_index_to_update = None
        self.des_index = des_index
        self.filtered_widths_indecies = filtered_widths_indecies
        self.selection_index = None
        self.queued_index = None
        
        self.q = Queue(None)
        self.updated_length = 0

    def update_length(self, subtracting_length, index):
        """ Update the length of part in the database via subtracting its length
        from the length of the design part
        """
        try:
            self.remained_lengths[index] -= subtracting_length
            return self.remained_lengths[index]
        except:
            msg = "### -----> Index is not in the list <----- ###"
            print(msg)
            return -1
    
    @classmethod
    def organize(cls, param_1, param_2, param_3):
        """ Organize the given data as parameters. This function is used to
            organize the elements with the criteria of length and the factor of 
            APE (Amount Per Element). 
            
            param_1: A set from the list of APE as inputs
            param_2: List of indecies of usable elements from the database
            param_3: Remained length of the usable elements in the database at the
                index of `param_2`
            
            returns: Dictionary of the data organized in the following way:
                       {
                    param_1: {
                        'index_list': [param_2],
                        'remained_lengths': [param_3]
                    }
                }
        """
        hashtable = dict()
        FIRST_ARG = 0
        SECOND_ARG = 1
        data = zip(param_1, param_2, param_3)
                
        for i in range(len(param_1)):
            hashtable[param_1[i]] = {'index_list': [], 'remained_lengths': []}
                    
        for i in range(len(data)):
            if data[i][FIRST_ARG] in hashtable.keys():
                hashtable[data[i][FIRST_ARG]]['index_list'].append(data[i][SECOND_ARG])
                hashtable[data[i][FIRST_ARG]]['remained_lengths'].append(param_3[i])
                        
        return hashtable

    def match_requirements(self):
        LAST_INDEX = -1
        FIRST_INDEX = 0
        
        data = self.organize(self.ape, self.db_index, self.remained_lengths)
        self.filtered_lengths_indecies = [data[key]['index_list'] for key in data]
        
        selected_ape = [k for k in data][LAST_INDEX] # e.g. 3
        print(selected_ape)
        
        self.db_index_to_update = data[selected_ape]['index_list'][0] # e.g. 12
        self.remainder = data[selected_ape]['remained_lengths'][0] # e.g. 1300.00
        
        self.lengths[0] # e.g. 357.00 updates by des_index change
        
        queued_index = self.filtered_widths_indecies[self.db_index_to_update] # 13
        
        # Have a for loop for all the parts in the design
            # Organize the part[i]
            # select the part with highest ape value
            # add the index of it to the q
            
            # run for loop iterating within (selected_ape) number of times: 
            # if part index is in q and the design part length is still less than
            # the database part's length at the q index: update remaining length
            # once break out of loop, remove the part from q
        # retun the final updated lengths of the part with index in the q

        node = []
        
        for key, value in data.items():
            if key == selected_ape:
                for index, item in enumerate(value['index_list']):
                    if index == FIRST_INDEX:
                        # Add the item and remained_lengths at the same index
                        # to the node as a tuple
                        node.append((item, value['remained_lengths'][index]))

        # Design Element Index
        dei = []
        # For now just working with one element. Later can be a list of lengths 
        for i in range(len(self.lengths)):
            for index, item in enumerate(self.db_index):
                
                if item == node[FIRST_INDEX][0]:
                    print(index, item)
                    # Update the length by subtracting the design element length
                    # from the database element length
                    self.updated_length = self.update_length(self.lengths[i], index)
                    dei.append(index)
    
            self.lengths.remove(self.lengths[i])
        self.q.print_queue()
        self.db_index_to_update = node[FIRST_INDEX][0]
        self.queued_index = queued_index
        self.design_elements_index = dei 
        return self.updated_length


if __name__ == "__main__":
    instance = PushDesignMethod()
    e = instance.match_requirements()
    print(e)
    remaining_length = e
    db_index_to_update = instance.queued_index
# ---------- end python_9 ----------

json = DeserializeKeysAndValues(JSON=organize_data)  # -> Key, Value
lastdex = LastIndex(List=json.Key)
ape = ListItem(List=json.Key, Index=lastdex, Wrap=True)
data_6 = Data(ape)
data_7 = ListItem(List=json.Value, Index=ape, Wrap=True)
data_8 = Data(data_7)
panel_17 = Panel([data_6, data_8])

# ---- group: Update Database
# Production Server: https://robotlab-residualwood.onrender.com/residual_wood/
id = Slider(3, range=0..10)
item_23 = ListItem(List=dejson_5, Index=expr("x - 1", python_9.db_index_to_update), Wrap=True)
dejsonkv_2 = DeserializeKeysAndValues(JSON=item_23)  # -> Key, Value
cull_i_4 = CullIndex(List=dejsonkv_2.Key, Indices=id, Wrap=True)
cull_i_5 = CullIndex(List=dejsonkv_2.Value, Indices=id, Wrap=True)
key = Panel("length")
keysearch_2 = KeyValueSearch(Keys=cull_i_4, Values=cull_i_5, Search=key)
# To Rollback:
# Switch the BODY with DATA output
index_2 = ItemIndex(List=cull_i_5, Item=keysearch_2)
development_server_2 = Panel("http://127.0.0.1:5000/residual_wood/")
data_to_update = Panel(python_9.remaining_length)
replace = ReplaceItems(List=cull_i_5, Item=python_9.remaining_length, Indices=index_2, Wrap=False)
rejsonkv_5 = SerializeKeysAndValues(Key=cull_i_4, Value=replace)
get_string_5 = GetString(rejsonkv_5, AtLeast=1, AtMost=2147483647, TreeAccess=False)
ctb_4 = CreateTextBody(
    Content=get_string_5,
    IsHtmlChecked=False,
    IsJavascriptChecked=False,
    IsJsonChecked=True,
    IsTextChecked=False,
    IsXmlChecked=False)
concat_3 = Concatenate(FragmentA=development_server, FragmentB=python_9.db_index_to_update)  # -> graft(Result)

# ----
item_24 = ListItem(List=move_3.Geometry, Index=expr("x - 1", python_9.db_index_to_update), Wrap=True)
bbox_3 = BoundingBox(Content=item_24, Plane=PlaneXY(0, 0, 0))  # -> Box, Box_2
int_10 = Integer(item_8)
debrep_6 = DeconstructBrep(Brep=bbox_3.Box)  # -> Faces, Edges, Vertices
item_25 = ListItem(List=debrep_6.Edges, Index=0, Wrap=True)
Y_4 = UnitY(Factor=1)
subtraction = Subtraction(A=int_10, B=milling_bit_radius)
divlength = DivideLength(Curve=item_25, Length=int_10)  # -> Points, Tangents, Parameters
len_6 = Length(Curve=item_25)
addition_5 = Addition(A=int_10, B=milling_bit_radius)
division_5 = Division(A=len_6, B=addition_5)
line = LineSDL(Start=divlength.Points, Direction=Y_4, Length=Slider(166, range=0..200))
panel_18 = Panel(division_5)
Z = UnitZ(Factor=Slider(100, range=0..100))
extr = Extrude(Base=line, Direction=Z)
X = UnitX(Factor=milling_bit_radius)
extr_2 = Extrude(Base=extr, Direction=X)
sdiff = SolidDifference(BrepsA=graft(bbox_3.Box), BrepsB=extr_2)  # -> simplify(Result)
bang_4 = ExplodeTree(Data=sdiff)
debrep_7 = DeconstructBrep(Brep=bang_4)  # -> Faces, Edges, Vertices
len_7 = Length(Curve=debrep_7.Edges)
cset_5 = CreateSet(List=len_7)  # -> Set, Map
sort_6 = SortList(Keys=cset_5.Set)  # -> reverse(Keys), ValuesA
item_26 = ListItem(List=sort_6.Keys, Index=0, Wrap=True)
int_11 = Integer(item_26)
equals = Equality(FirstNumber=flatten(int_11), SecondNumber=subtraction)  # -> Equality, Inequality
cull_4 = CullPattern(List=bang_4, CullPattern=equals.Equality)

# ----
# 50 ms
# Once ready, click the Datadam
# to update the database
dam_4 = DataDam(DataB=concat_3, DataA=ctb_4, BufferDelay=5000000, BufferMode=0)  # -> DataB, DataA
put = PUTRequest(URL=dam_4.DataB, Body=dam_4.DataA)  # -> Status, Content, flatten(Response)
panel_19 = Panel(put.Response)

flatten = FlattenTree(Tree=ctb_4, Path="{0}")
flatten_2 = FlattenTree(Tree=concat_3, Path="{0}")
panel_20 = Panel(flatten_2)
panel_21 = Panel(flatten)

sort_7 = SortList(Keys=dejson_3.Id, ValuesA=boxrec)  # -> Keys, ValuesA; disabled
cset_6 = CreateSet(List=item_3)  # -> Set, Map; disabled
lng_8 = ListLength(List=cset_6.Set)  # disabled

clean = CleanTree(RemoveNulls=True, RemoveInvalid=True, RemoveEmpty=invert(False), Tree=simplify(python_3.ratios))  # disabled
data_9 = Data(sort.ValuesA)  # disabled
item_27 = ListItem(List=clean, Index=0, Wrap=True)  # -> flatten(Item), flatten(Item1); disabled
sort_8 = SortList(Lengths=item_27.Item1, ValuesBlocks=item_27.Item)  # -> Sorted_lengths, ValuesBlocks; disabled
sort_9 = SortList(Keys=python_3.available_length)  # -> Keys, ValuesA; disabled

# ---- group: ANALYTICS
number_slider_8 = Slider(0.4, range=0..1)  # disabled
eval = EvaluateCurve(Curve=reparameterize(data_9), Parameter=number_slider_8)  # -> Point, Tangent, Angle; disabled
midpt = CurveMiddle(Curve=data_9)  # disabled
move_4 = Move(Geometry=eval.Point, Motion=Vector(0, 0, 10))  # -> Geometry, Transform; disabled
sort_10 = SortList(Keys=sort_9.Keys, ValuesA=midpt)  # -> Keys, ValuesA; disabled
python_10 = GhPythonScript(anchor=sort_9.Keys, data=sort_8.Sorted_lengths)  # -> a; inputs anchor: list, data: list; disabled
# ---------- python_10: Python ----------
"""_Analitics_"""

def analyze(anchor, data):

    values = tuple(zip(anchor, data))
    diff = [values[i][1] - values[i][0] for i in range(len(anchor))]
    
    percentages = [
            "% " + str(round((diff[i] / anchor[i]) * 100, 2))
            for i in range(len(anchor))
        ]
    return percentages

a = analyze(anchor, data)
# ---------- end python_10 ----------
yz = YZPlane(Origin=sort_10.ValuesA)  # disabled
swatch = ColourSwatch(SwatchColor=RGB(255, 255, 255))  # disabled
data_10 = Data(item_2)  # disabled
txt = Text(data_10)  # disabled
number_slider_9 = Slider(1.646, range=0..10)  # disabled
swatch_2 = ColourSwatch(SwatchColor=RGB(0, 255, 229))  # disabled
tag_2 = TextTag(Location=yz, Text=python_10, Colour=swatch)  # disabled
yz_2 = YZPlane(Origin=move_4.Geometry)  # disabled
tag_3 = TextTag3D(Location=yz_2, Text=txt, Size=number_slider_9, Colour=swatch_2, Justification=7)  # disabled

# ---- group: Find closest lengths
python_11 = GhPythonScript(design_lengths=sort_9.Keys, database_lengths=item_27.Item1)  # -> nearest_lengths; inputs design_lengths: list, database_lengths: list; disabled; same code as python_2

# ----
keysearch_3 = KeyValueSearch(Keys=sort_8.Sorted_lengths, Values=sort_8.ValuesBlocks, Search=python_11)  # disabled
index_3 = ItemIndex(List=python_3.all_blocks, Item=keysearch_3)  # disabled

data_11 = Data(keysearch_3)  # disabled
debrep_8 = DeconstructBrep(Brep=data_11)  # -> Faces, Edges, Vertices; disabled
item_28 = ListItem(List=debrep_8.Faces, Index=0, Wrap=True)  # -> Item, Item1; disabled
md_slider = MDSlider(
    SliderMode=0,
    slider_value=Point(0.5010223389, 0.5010242462, 0.5),
    x_domain=Domain(0, 1),
    y_domain=Domain(0, 1),
    z_domain=Domain(0, 1))  # disabled
data_12 = Data(item_28.Item1)  # disabled
evalsrf = EvaluateSurface(Surface=reparameterize(data_12), Point=md_slider)  # -> Point, Normal, UDirection, VDirection, Frame; disabled
number_slider_10 = Slider(90, range=-90..90)  # disabled
pflip = FlipPlane(Plane=data_9, ReverseX=False, ReverseY=False, SwapAxes=True)  # disabled
prot = RotatePlane(Plane=pflip, Angle=degrees(number_slider_10))  # disabled
orient = Orient(Geometry=data_11, Source=flatten(evalsrf.Frame), Target=prot)  # -> Geometry, Transform; disabled

# ---- group: OUTPUT TO BAKE
geo = Geometry(orient.Geometry)  # disabled

# ----
lng_9 = ListLength(List=orient.Geometry)  # disabled
min = Minimum(A=lng_8, B=lng_9)  # disabled
series_10 = Series(Start=0, Step=1, Count=min)  # disabled
item_29 = ListItem(List=orient.Geometry, Index=series_10, Wrap=True)  # disabled
replace_2 = ReplaceItems(List=python_3.all_blocks, Item=item_29, Indices=cset_6.Set, Wrap=False)  # disabled
preview_3 = CustomPreview(Geometry=replace_2, Material=cluster.C)  # disabled
preview_4 = CustomPreview(Geometry=geo, Material=cluster.C)  # disabled

# ---- group: API call to remove the used wood based on ID (continued)
item_30 = ListItem(List=dejson_3.Id, Index=index_3, Wrap=True)  # disabled

# ---- group: API call to remove the used wood based on ID / Removed Indecies
data_13 = Data(item_30)  # disabled

# ---- group: API call to remove the used wood based on ID (continued)
concat_4 = Concatenate(FragmentA=panel_12, FragmentB=panel_13, FragmentA_2=data_13)  # disabled
delete = DELETERequest(URL=concat_4)  # -> Status, Content, Response; disabled
panel_22 = Panel(delete.Response)  # disabled

# ==== cluster Cluster
count = ClusterInput()

vb = VBScript(genelist="GeneList D", count=count)  # -> out, A
# ---------- vb: VB ----------
    For Each obj As IGH_DocumentObject In owner.OnPingDocument().Objects
      If (obj.ComponentGuid <> New Guid("{21553c44-ea62-475e-a8bb-62b2a3ee5ca5}")) Then Continue For
      If (obj.NickName Like genelist) Then
        CallByName(obj, "Count", CallType.Set, count)
        'CallByName(obj, "ExpireSolution", CallType.Method, False)
        Return
      End If
    Next

    Print("No matching Gene list object found")
# ---------- end vb ----------
vb_2 = VBScript(genelist="GeneList E", count=count)  # -> out, A; same code as vb
vb_3 = VBScript(genelist="GeneList F", count=count)  # -> out, A; same code as vb
vb_4 = VBScript(genelist="GeneList G", count=count)  # -> out, A; same code as vb
genelist_d = GeneList(
    Decimals=2,
    Maximum=255,
    Minimum=200,
    Value=[249.6870825, 227.159727, 220.7125882, 221.879463, 240.3877779, 247.7977078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])
genelist_e = GeneList(
    Decimals=2,
    Maximum=140,
    Minimum=120,
    Value=[123.301908, 126.2742014, 136.988057, 120.8476593, 139.8469819, 137.5064603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])
genelist_f = GeneList(
    Decimals=2,
    Maximum=90,
    Minimum=20,
    Value=[47.66573956, 64.54453612, 31.81359346, 80.80078899, 53.74216505, 67.76083834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])
genelist_g = GeneList(
    Decimals=2,
    Maximum=1000,
    Minimum=120,
    Value=[449.58535, 864.1659569, 128.0886553, 422.1313001, 285.0884081, 694.9051328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])
rgb = ColourRGB(Alpha=150, Red=genelist_d, Green=genelist_e, Blue=genelist_f)

vb_5 = VBScript(genelist="GeneList B", count=count)  # -> out, A; same code as vb
vb_6 = VBScript(genelist="GeneList A", count=count)  # -> out, A; same code as vb
vb_7 = VBScript(genelist="GeneList C", count=count)  # -> out, A; same code as vb
genelist_g_2 = ClusterOutput(genelist_g)

genelist_b = GeneList(
    Decimals=2,
    Maximum=25,
    Minimum=10,
    Value=[12.59518988, 16.61877447, 15.3142289, 23.44315202, 20.79544497, 15.52627439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])
genelist_a = GeneList(
    Decimals=2,
    Maximum=35,
    Minimum=30,
    Value=[33.88890474, 34.71611187, 30.6836495, 30.45055322, 32.85169996, 30.87290662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])
genelist_c = GeneList(
    Decimals=2,
    Maximum=3,
    Minimum=2,
    Value=[2.357290426, 2.185102099, 2.981203596, 2.288344855, 2.073907413, 2.381113439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])

C = ClusterOutput(rgb)
genelist_b_2 = ClusterOutput(genelist_b)
genelist_a_2 = ClusterOutput(genelist_a)
genelist_c_2 = ClusterOutput(genelist_c)
